# Grasshopper definition 15 second stair.gh (Grasshopper 1.0.7)

minium_head_height_ft = Slider(6.66, range=6.66..10)
does_stair_continue_in_same_direction = BooleanToggle(False)
of_stairs_before_landing = Slider(14, range=1..18)
left_right = BooleanToggle(True)
perpendicular = BooleanToggle(True)
width_inches = Slider(80.83, range=36..200)
depth_inches = Slider(11, range=11..20)
# Basic Tutorial:
# 
# https://youtu.be/E8npvh60mWk?feature=shared
# Inputs:
starting_point = Point(Point(25.5, 40.88425803, 0))

# ---- group: Top Floor Plate
brep = Brep(<brep referenced from the Rhino model>)

# ----
deconstruct = Deconstruct(Point=starting_point)  # -> XComponent, YComponent, ZComponent
deconstruct_brep = DeconstructBrep(Brep=brep)  # -> Faces, Edges, Vertices
negative = Negative(Value=width_inches)
division = Division(A=depth_inches, B=12)
deconstruct_2 = Deconstruct(Point=deconstruct_brep.Vertices)  # -> XComponent, YComponent, ZComponent
ghpython_script = GhPythonScript(y=negative, z=width_inches, u=left_right)  # -> out, a
# ---------- ghpython_script: Python ----------
__author__ = "Hannah"
__version__ = "2024.01.15"

import rhinoscriptsyntax as rs

if u > 0:
    a=y
else:
    a=z
# ---------- end ghpython_script ----------
addition = Addition(A=deconstruct.YComponent, B=division)
division_2 = Division(A=ghpython_script.a, B=12)
sort_list = SortList(Keys=deconstruct_2.ZComponent, ValuesValuesA=deconstruct_brep.Vertices)  # -> reverse(Keys), reverse(ValuesValuesA)
addition_2 = Addition(A=deconstruct.XComponent, B=division_2)
list_item = ListItem(List=sort_list.Keys, Index=0, Wrap=True)
subtraction = Subtraction(A=list_item, B=deconstruct.ZComponent)
multiplication = Multiplication(A=subtraction, B=12)
ghpython_script_2 = GhPythonScript(y=width_inches)  # -> out, a
# ---------- ghpython_script_2: Python ----------
__author__ = "Hannah"
__version__ = "2024.01.15"

import rhinoscriptsyntax as rs

if y < 48:
    a=y
else:
    a=48
# ---------- end ghpython_script_2 ----------
series = Series(Start=ghpython_script_2.a, Step=1, Count=100)
ghpython_script_3 = GhPythonScript(y=does_stair_continue_in_same_direction)  # -> out, a
# ---------- ghpython_script_3: Python ----------
__author__ = "Hannah"
__version__ = "2024.01.15"

import rhinoscriptsyntax as rs

if y > 0:
    a=1
else:
    a=2
# ---------- end ghpython_script_3 ----------
multiplication_2 = Multiplication(A=division_2, B=ghpython_script_3.a)
unit_z = UnitZ(Factor=1)
# Landing/After Landing:
line_sdl = LineSDL(Start=starting_point, Direction=unit_z, Length=1)
construct_point = ConstructPoint(XCoordinate=addition_2, YCoordinate=addition, ZCoordinate=minium_head_height_ft)
box_2pt = Box2Pt(PointA=starting_point, PointB=construct_point, Plane=PlaneXY(0, 0, 0))
colour_cmyk = ColourCMYK(Cyan=0, Magenta=0, Yellow=0, Key=0)

rise_inches = Slider(6.705, range=4..7)

division_3 = Division(A=multiplication, B=rise_inches)
ghpython_script_4 = GhPythonScript(u=division_3)  # -> out, a
# ---------- ghpython_script_4: Python ----------
__author__ = "Hannah"
__version__ = "2024.01.15"

import rhinoscriptsyntax as rs

if u > 0:
    a=int(u)
else:
    a=0
# ---------- end ghpython_script_4 ----------
division_4 = Division(A=multiplication, B=ghpython_script_4.a)
# Stairs:
ghpython_script_5 = GhPythonScript(y=multiplication, z=ghpython_script_4.a, u=division_4)  # -> out, a, b
# ---------- ghpython_script_5: Python ----------
__author__ = "Hannah"
__version__ = "2024.01.15"

import rhinoscriptsyntax as rs

if u <= 7:
    a= u
    b= z
else:
    a= y/(z-1)
    b= z-1
# ---------- end ghpython_script_5 ----------

rise_for_whole_of_stairs = Panel(ghpython_script_5.a)

division_5 = Division(A=ghpython_script_5.a, B=12)
addition_3 = Addition(A=deconstruct.ZComponent, B=division_5)
construct_point_2 = ConstructPoint(XCoordinate=addition_2, YCoordinate=addition, ZCoordinate=addition_3)
box_2pt_2 = Box2Pt(PointA=starting_point, PointB=construct_point_2, Plane=PlaneXY(0, 0, 0))
box_corners = BoxCorners(Box=box_2pt_2)  # -> CornerA, CornerB, CornerC, CornerD, CornerE, CornerF, CornerG, CornerH
vector_2pt = Vector2Pt(PointA=box_corners.CornerD, PointB=box_corners.CornerE, Unitize=False)  # -> Vector, Length
linear_array = LinearArray(Geometry=box_2pt_2, Direction=vector_2pt.Vector, Count=ghpython_script_5.b)  # -> Geometry, Transform
split_list = SplitList(List=linear_array.Geometry, Index=of_stairs_before_landing)  # -> ListA, ListB
list_length = ListLength(List=split_list.ListB)
reverse_list = ReverseList(List=split_list.ListA)
list_item_2 = ListItem(List=reverse_list, Index=0, Wrap=True)
subtraction_2 = Subtraction(A=list_length, B=1)
box_corners_2 = BoxCorners(Box=list_item_2)  # -> CornerA, CornerB, CornerC, CornerD, CornerE, CornerF, CornerG, CornerH
ghpython_script_6 = GhPythonScript(y=left_right, z=box_corners_2.CornerE, u=box_corners_2.CornerF)  # -> out, a
# ---------- ghpython_script_6: Python ----------
__author__ = "Hannah"
__version__ = "2024.01.15"

import rhinoscriptsyntax as rs

if y == 0:
    a=z
else:
    a=u
# ---------- end ghpython_script_6 ----------
point = Point(ghpython_script_6.a)
deconstruct_3 = Deconstruct(Point=point)  # -> XComponent, YComponent, ZComponent
addition_4 = Addition(A=deconstruct_3.XComponent, B=multiplication_2)
negative_2 = Negative(Value=addition_4)
construct_point_3 = ConstructPoint(XCoordinate=addition_4, YCoordinate=deconstruct_3.YComponent, ZCoordinate=deconstruct_3.ZComponent)
linear_array_2 = LinearArray(Geometry=box_2pt, Direction=vector_2pt.Vector, Count=ghpython_script_5.b)  # -> Geometry, Transform
brep_2 = Brep(reverse_list)
reverse_list_2 = ReverseList(List=brep_2)
collision_one_many = CollisionOneMany(Collider=brep, Obstacles=linear_array_2.Geometry)  # -> Collision, Index
list_item_3 = ListItem(List=reverse_list_2, Index=0, Wrap=True)
list_item_4 = ListItem(List=linear_array_2.Geometry, Index=collision_one_many.Index, Wrap=True)
# Head Height:
box_corners_3 = BoxCorners(Box=list_item_3)  # -> CornerA, CornerB, CornerC, CornerD, CornerE, CornerF, CornerG, CornerH
box_corners_4 = BoxCorners(Box=list_item_4)  # -> CornerA, CornerB, CornerC, CornerD, CornerE, CornerF, CornerG, CornerH
deconstruct_4 = Deconstruct(Point=box_corners_3.CornerG)  # -> XComponent, YComponent, ZComponent
deconstruct_5 = Deconstruct(Point=box_corners_4.CornerA)  # -> XComponent, YComponent, ZComponent
construct_plane = ConstructPlane(Origin=box_corners_4.CornerA, XAxis=Vector(1, 0, 0), YAxis=Vector(0, 1, 0))
construct_point_4 = ConstructPoint(XCoordinate=deconstruct_4.XComponent, YCoordinate=deconstruct_4.YComponent, ZCoordinate=deconstruct_5.ZComponent)
rectangle_2pt = Rectangle2Pt(Plane=construct_plane, PointA=box_corners_4.CornerA, PointB=construct_point_4, Radius=0)  # -> Rectangle, Length
head_hight_volume = BoxRectangle(Rectangle=rectangle_2pt.Rectangle, Height=Domain(0, 10))

# ---- group: Bake Head Hight Volume
brep_3 = Brep(head_hight_volume)

# ----
_0_min_landing_depth = Slider(40, range=0..100)

list_item_5 = ListItem(List=series, Index=_0_min_landing_depth, Wrap=True)

landing_depth = Panel(list_item_5)

division_6 = Division(A=list_item_5, B=12)
subtraction_3 = Subtraction(A=deconstruct_3.YComponent, B=division_6)
construct_point_5 = ConstructPoint(XCoordinate=deconstruct_3.XComponent, YCoordinate=subtraction_3, ZCoordinate=deconstruct_3.ZComponent)
rectangle_3pt = Rectangle3Pt(PointA=point, PointB=construct_point_5, PointC=construct_point_3)  # -> Rectangle, Length
point_2 = Point(construct_point_5)
box_rectangle = BoxRectangle(Rectangle=rectangle_3pt.Rectangle, Height=division_5)
box_corners_5 = BoxCorners(Box=box_rectangle)  # -> CornerA, CornerB, CornerC, CornerD, CornerE, CornerF, CornerG, CornerH
ghpython_script_7 = GhPythonScript(y=does_stair_continue_in_same_direction, z=box_corners_5.CornerG, u=box_corners_5.CornerH)  # -> out, a
# ---------- ghpython_script_7: Python ----------
__author__ = "Hannah"
__version__ = "2024.01.15"

import rhinoscriptsyntax as rs

if y > 0:
    a=z
else:
    a=u
# ---------- end ghpython_script_7 ----------
deconstruct_6 = Deconstruct(Point=ghpython_script_7.a)  # -> XComponent, YComponent, ZComponent
addition_5 = Addition(A=deconstruct_6.ZComponent, B=division_5)
subtraction_4 = Subtraction(A=deconstruct_6.XComponent, B=division_2)
addition_6 = Addition(A=deconstruct_6.YComponent, B=division)
construct_point_6 = ConstructPoint(XCoordinate=subtraction_4, YCoordinate=addition_6, ZCoordinate=addition_5)
box_2pt_3 = Box2Pt(PointA=ghpython_script_7.a, PointB=construct_point_6, Plane=PlaneXY(0, 0, 0))
box_corners_6 = BoxCorners(Box=box_2pt_3)  # -> CornerA, CornerB, CornerC, CornerD, CornerE, CornerF, CornerG, CornerH
vector_2pt_2 = Vector2Pt(PointA=box_corners_6.CornerD, PointB=box_corners_6.CornerE, Unitize=False)  # -> Vector, Length
vector_2pt_3 = Vector2Pt(PointA=box_corners_6.CornerA, PointB=box_corners_6.CornerH, Unitize=False)  # -> Vector, Length
ghpython_script_8 = GhPythonScript(y=does_stair_continue_in_same_direction, z=vector_2pt_2.Vector, u=vector_2pt_3.Vector)  # -> out, a; same code as ghpython_script_7
linear_array_3 = LinearArray(Geometry=box_2pt_3, Direction=ghpython_script_8.a, Count=subtraction_2)  # -> Geometry, Transform
brep_4 = Brep([split_list.ListA, linear_array_3.Geometry, box_rectangle])
brep_5 = Brep(brep_4)
rotate_axis = RotateAxis(Geometry=brep_5, Angle=degrees("90"), Axis=line_sdl)  # -> Geometry, Transform
ghpython_script_9 = GhPythonScript(x=perpendicular, y=brep_5, z=rotate_axis.Geometry)  # -> out, a
# ---------- ghpython_script_9: Python ----------
__author__ = "Hannah"
__version__ = "2024.01.15"

import rhinoscriptsyntax as rs

if x == 0:
    a=y
else:
    a=z
# ---------- end ghpython_script_9 ----------

# ---- group: Bake Stairs
# Outputs:
brep_6 = Brep(ghpython_script_9.a)

# ----
brep_7 = Brep(ghpython_script_9.a)
custom_preview = CustomPreview(Geometry=brep_7, Material=colour_cmyk)
